# Grasshopper definition ThermalComfort.gh (Grasshopper 1.0.7)
# plug-ins: CORE.Grasshopper.Colibri

panel = Panel("C:\Users\amitc\Documents\GitHub\IIT-PhD\HackSimBuild\os_workflow\measures\PowerOutage")

# ---- group: Context!
brep = Brep([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])
shade = HBShade(geo=brep)  # -> report, shades; plug-in component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

# ----
power_outage = SetResidentialPowerOutage(measure_path=panel, otg_date="Janurary 20", otg_hr=Slider(1, range=0..23), otg_len=Slider(168, range=1..168))  # -> out, measure; plug-in component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
boolean_toggle = BooleanToggle(True)

# ---- group: Opaque Faces
geometry = Geometry([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])
intsolid = HBIntersectSolids(solids=flatten(geometry), run=Toggle(True))  # -> int_solids; plug-in component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
roomsolid = HBRoomFromSolid(
    geo=flatten(intsolid),
    name="TestRoom",
    constr_set="2013::ClimateZone5::SteelFramed",
    program="2013::LargeOffice::OpenOffice",
    conditioned=True)  # -> report, rooms; plug-in component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
solveadj = HBSolveAdjacency(rooms=flatten(roomsolid.rooms), air_boundary=boolean_toggle, run=boolean_toggle)  # -> report, adj_rooms; plug-in component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

# ---- group: Apertures
# Geometry Preparation
brep_2 = Brep([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])
aperture = HBAperture(geo=brep_2)  # -> report, apertures; plug-in component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
addsubface = HBAddSubface(hb_obj=flatten(solveadj.adj_rooms), sub_faces=flatten(aperture.apertures))  # -> hb_obj; plug-in component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
bordershades = HBExtrudedBorderShades(hb_objs=flatten(addsubface), depth="0.3")  # -> report, hb_objs; plug-in component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

# ----
panel_2 = Panel("C:\Users\amitc\Documents\GitHub\IIT-PhD\HackSimBuild\os_workflow\seeds\two_story_clean.osm")
hour_of_8760 = Slider(440, range=200..600)
simoutput = HBSimulationOutput(comfort_metrics=Toggle(True))  # -> out, sim_output; plug-in component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
simpar = HBSimulationParameter(output=simoutput.sim_output, timestep=6)  # -> sim_par; plug-in component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
loademodel = HBLoadGbXMLOSMIDF(model_file=panel_2, load=Toggle(True))  # -> out, model; plug-in component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

# ----
# Model
# + Grids
panel_3 = Panel("sample_model_grid")
model = HBModel(rooms=flatten(bordershades.hb_objs), shades=flatten(shade.shades), name=panel_3)  # -> report, model; plug-in component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
gridrooms = HBSensorGridFromRooms(rooms=bordershades.hb_objs, grid_size="0.5")  # -> grid, points, mesh; plug-in component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
vizwiref = HBVisualizeWireframe(hb_objs=flatten(model.model))  # -> geo; plug-in component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
assigngridsviews = HBAssignGridsAndViews(model=model.model, grids=flatten(gridrooms.grid))  # -> model; plug-in component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

hour2date = GhPythonScript(Input=hour_of_8760)  # -> out, Month, Day, Hour
# ---------- hour2date: Python ----------
__author__ = "PHIUS AM"
__version__ = "2022.09.16"

import rhinoscriptsyntax as rs
import math

if Input <= 744:
    Month = 1
    Day = math.trunc(Input / 24)
    Hour = Input % 24
    print(Month,Day,Hour)
if Input >744 and Input <=1416:
    Month = 2
    Day = math.trunc(Input / 24) -31
    Hour = Input % 24
    print(Month,Day,Hour)
if Input >1416 and Input <=2160:
    Month = 3
    Day = math.trunc(Input / 24) -59
    Hour = Input % 24
    print(Month,Day,Hour)
if Input >2160 and Input <=2880:
    Month = 4
    Day = math.trunc(Input / 24) -90
    Hour = Input % 24
    print(Month,Day,Hour)
if Input >2880 and Input <=3624:
    Month = 5
    Day = math.trunc(Input / 24) -120
    Hour = Input % 24
    print(Month,Day,Hour)
if Input >3624 and Input <=4344:
    Month = 6
    Day = math.trunc(Input / 24) -151
    Hour = Input % 24
    print(Month,Day,Hour)
if Input >4344 and Input <=5088:
    Month = 7
    Day = math.trunc(Input / 24) -181
    Hour = Input % 24
    print(Month,Day,Hour)
if Input >5088 and Input <=5832:
    Month = 8
    Day = math.trunc(Input / 24) -212
    Hour = Input % 24
    print(Month,Day,Hour)
if Input >5832 and Input <=6552:
    Month = 9
    Day = math.trunc(Input / 24) -243
    Hour = Input % 24
    print(Month,Day,Hour)
if Input >6552 and Input <=7296:
    Month = 10
    Day = math.trunc(Input / 24) -273
    Hour = Input % 24
    print(Month,Day,Hour)
if Input >7296 and Input <=8016:
    Month = 11
    Day = math.trunc(Input / 24) -304
    Hour = Input % 24
    print(Month,Day,Hour)
if Input >8016 and Input <=8760:
    Month = 12
    Day = math.trunc(Input / 24) -334
    Hour = Input % 24
    print(Month,Day,Hour)
# ---------- end hour2date ----------

# ----
# EPW
panel_4 = Panel("https://energyplus-weather.s3.amazonaws.com/north_and_central_america_wmo_region_4/USA/MA/USA_MA_Boston-Logan.Intl.AP.725090_TMY3/USA_MA_Boston-Logan.Intl.AP.725090_TMY3.zip")
downloadepw = LBDownloadWeather(weather_URL=panel_4)  # -> epw_file, stat_file, ddy_file; plug-in component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

hour_of_8760_2 = Slider(2523, range=1..8760)
panel_5 = Panel([hour2date.Month, hour2date.Day, hour2date.Hour])
boolean_toggle_2 = BooleanToggle(True)
modeltoosm = HBModelToOSM(
    model=loademodel.model,
    epw_file=downloadepw.epw_file,
    sim_par=simpar,
    measures=power_outage.measure,
    write=boolean_toggle_2,
    run=boolean_toggle_2)  # -> out, jsons, osw, osm, idf, sql, zsz, rdd, html; plug-in component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
panel_6 = Panel(modeltoosm.osm)
panel_7 = Panel("C:\Users\amitc\Documents\GitHub\IIT-PhD\HackSimBuild\testSim")

# ----
# Run Recipe
panel_8 = Panel("0.8")
pmvmap = HBPMVComfortMap(model=assigngridsviews, epw=downloadepw.epw_file, ddy=downloadepw.ddy_file, clo_value=panel_8, run=Toggle(False))  # -> report, env_conds, temperature, condition, pmv, TCP, HSP, CSP; plug-in component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

ghpython_script = GhPythonScript(fp=modeltoosm.idf)  # -> out, a
# ---------- ghpython_script: Python ----------
from honeybee_energy.schedule.ruleset import ScheduleRuleset

a = ScheduleRuleset.extract_all_from_idf_file(fp)
# ---------- end ghpython_script ----------
legendpar = LBLegendParameters(min="0", max="30", seg_count="10")  # -> leg_par; plug-in component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
loademodel_2 = HBLoadGbXMLOSMIDF(model_file=modeltoosm.osm, load=Toggle(True))  # -> out, model; plug-in component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
hb_room_attributes = HBRoomAttributes({"Display Name": "display_name", "Simulation Name (Identifier)": "identifier", "Multiplier": "multiplier", "Floor Area Excluded": "exclude_floor_area", "Story": "story", "Volume": "volume", "Gross Floor Area": "floor_area", "Exposed Area": "exposed_area", "Exterior Wall Area": "exterior_wall_area", "Exterior Aperture Area": "exterior_aperture_area", "Average Floor Elevation": "average_floor_height"}, selected="Display Name")
roomsbyattr = HBRoomsByAttribute(rooms=flatten(loademodel_2.model), attribute=hb_room_attributes)  # -> values, rooms; plug-in component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

panel_9 = Panel("""10
11""")
mesh_join = MeshJoin(Meshes=gridrooms.mesh)
colrange = LBColorRange(index=panel_9)  # -> colors; plug-in component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
legendpar_2 = LBLegendParameters(colors=colrange)  # -> leg_par; plug-in component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
move = Move(Geometry=mesh_join, Motion="40,0,0")  # -> Geometry, Transform
move_2 = Move(Geometry=vizwiref, Motion="40,0,0")  # -> Geometry, Transform
explode_tree = ExplodeTree(Data=simplify(legendpar_2))  # -> Branch0, Branch1
heatmap = LBSpatialHeatmap(values=flatten(pmvmap.HSP), mesh=mesh_join, legend_par=explode_tree.Branch0, legend_title="%")  # -> mesh, legend, title, colors, legend_par; plug-in component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
heatmap_2 = LBSpatialHeatmap(values=flatten(pmvmap.CSP), mesh=move.Geometry, legend_par=explode_tree.Branch1, legend_title="%")  # -> mesh, legend, title, colors, legend_par; plug-in component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

# ----
# Model
# + Grids
panel_10 = Panel("sample_model_grid")
model_2 = HBModel(rooms=flatten(roomsbyattr.rooms), name=panel_10)  # -> report, model; plug-in component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
gridrooms_2 = HBSensorGridFromRooms(rooms=roomsbyattr.rooms, grid_size="1")  # -> grid, points, mesh; plug-in component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
vizwiref_2 = HBVisualizeWireframe(hb_objs=flatten(model_2.model))  # -> geo; plug-in component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
assigngridsviews_2 = HBAssignGridsAndViews(model=model_2.model, grids=flatten(gridrooms_2.grid))  # -> model; plug-in component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

# ----
# EPW
panel_11 = Panel("https://energyplus-weather.s3.amazonaws.com/north_and_central_america_wmo_region_4/USA/MA/USA_MA_Boston-Logan.Intl.AP.725090_TMY3/USA_MA_Boston-Logan.Intl.AP.725090_TMY3.zip")
downloadepw_2 = LBDownloadWeather(weather_URL=panel_11)  # -> epw_file, stat_file, ddy_file; plug-in component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

number_slider = Slider(1, range=0..1)
analysisperiod = LBAnalysisPeriod(
    start_month=Slider(1, range=0..1),
    start_day=Slider(10, range=0..10),
    start_hour=Slider(1, range=0..100),
    end_month=Slider(2, range=0..10),
    end_day=Slider(10, range=0..10),
    end_hour=number_slider,
    timestep=number_slider)  # -> period, hoys, dates; plug-in component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

# ----
# Run Recipe
panel_12 = Panel("0.8")
pmvmap_2 = HBPMVComfortMap(
    model=assigngridsviews_2,
    epw=downloadepw_2.epw_file,
    ddy=downloadepw_2.ddy_file,
    run_period=analysisperiod.period,
    clo_value=panel_12,
    run=Toggle(True))  # -> report, env_conds, temperature, condition, pmv, TCP, HSP, CSP; plug-in component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

modded_hour = Slider(2, range=1..21)
colibri_inputs_iterator = ColibriInputsIterator(Modded_Hour=modded_hour, ignoreAllWarningMsg=True)  # -> UniqueName, Inputs, Modded_Hour
colibri_aggregator = ColibriAggregator(Folder=panel_7, Inputs=colibri_inputs_iterator.Inputs, Write=Toggle(False), recordingMode=0)

# ----
# Load Temperature Data
thermalmtx = HBReadThermalMatrix(comf_result=pmvmap.temperature, load=Toggle(False))  # -> comf_mtx; plug-in component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
vizthermalmap = HBVisualizeThermalMap(comf_mtx=thermalmtx, mesh=flatten(gridrooms.mesh), sim_step=modded_hour, legend_par=legendpar)  # -> report, mesh, legend, title, colors, values; plug-in component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

# ---- group: Simple OSM Color Room
roomcomfortresult = HBReadRoomComfortResult(sql=modeltoosm.sql)  # -> oper_temp, air_temp, rad_temp, rel_humidity; plug-in component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
colorrooms = HBColorRooms(
    data=flatten(roomcomfortresult.oper_temp),
    rooms_model=flatten(loademodel.model),
    sim_step=modded_hour,
    legend_par=legendpar)  # -> readMe, mesh, wire_frame, legend, title, rooms, colors, values; plug-in component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

# ----
legendpar_3 = LBLegendParameters(min="5", max="20", seg_count="10")  # -> leg_par; plug-in component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

# ----
# Load Temperature Data
thermalmtx_2 = HBReadThermalMatrix(comf_result=pmvmap_2.temperature, load=Toggle(True))  # -> comf_mtx; plug-in component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
vizthermalmap_2 = HBVisualizeThermalMap(
    comf_mtx=thermalmtx_2,
    mesh=flatten(gridrooms_2.mesh),
    sim_step=modded_hour,
    period=analysisperiod.period,
    legend_par=legendpar_3)  # -> report, mesh, legend, title, colors, values; plug-in component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
